test file "Observer_Test_results"

suite "Tests"

  case "Line test" [baseline]
    model Observer_Harness
    signal scenario: Line (Observer_Harness/Harness Inputs)
    baseline "x1.mat": abs tol 5, rel tol 0.2, leading tol 5, lagging tol 5
      x_hat

  case "Triangle test" [baseline]
    model Observer_Harness
    signal scenario: Triangle (Observer_Harness/Harness Inputs)
    baseline "x1.mat": abs tol 10, rel tol 0.3, leading tol 10, lagging tol 10
      x_hat

  case "Trapezoid test" [baseline]
    model Observer_Harness
    signal scenario: Trapezoid (Observer_Harness/Harness Inputs)
    baseline "x1.mat": abs tol 10, rel tol 0.3, leading tol 10, lagging tol 10
      x_hat